# Grasshopper definition create_problem.gh (Grasshopper 1.0.7)

pt = Point(Point(9.900237953, 10.13047604, 0))
pt_2 = Point(Point(9.900237953, 0.1534920613, 0))
pt_3 = Point(Point(-0.07693741725, 0, 0.1154061259))
pt_4 = Point(Point(-0.1534920613, 9.976983983, 0))
pt_5 = Point(Point(19.95396797, 0.07674603064, 0))
pt_6 = Point(Point(20.030714, 9.900237953, 0))
typechoice = TypeChoice({"Libre (L)": "L", "Commun Possible (C)": "C", "Commun Imposé (I)": "I", "Entrée-Sortie (X)": "X"}, selected="Commun Possible (C)")
typechoice_2 = TypeChoice({"Libre (L)": "L", "Commun Possible (C)": "C", "Commun Imposé (I)": "I", "Entrée-Sortie (X)": "X"}, selected="Libre (L)")
typechoice_3 = TypeChoice({"Libre (L)": "L", "Commun Possible (C)": "C", "Commun Imposé (I)": "I", "Entrée-Sortie (X)": "X"}, selected="Entrée-Sortie (X)")
element = CreateElement(type=typechoice_2, points=[pt_3, pt_4, pt, pt_2])  # -> out, element; inputs points: list of Point3d
# ---------- element: Python ----------
"""Provides a scripting component.
    Inputs:
        type: A string which détermines the type of the element
        bonus : The bonus set to the element, not mandatory and 0 by default
        points: A list of points which determines the object
    Output:
        element: The Element created"""
        
__author__ = "asjou"
__version__ = "2022.02.28"
        
import rhinoscriptsyntax as rs
        
from abitaPy2 import Point
from abitaPy2 import Element
        
if(len(points)<3):
    raise Exception("Not enough points! (" + str(len(points)) + ")")
        
elt = Element(-1, -1)
        
if bonus:
    elt.bonus = bonus
        
for p in points:
    po = Point(p.X, p.Y, -1, -1)
    elt.addPoint(po)
elt.close()
        
if not type:
    type = "L"
if type == 'C' or type == 'I' or type == 'X':
    elt.common = True
    if type == 'I' or type == 'X':
        elt.imposed = True
        if type == 'X':
            elt.exit = True
        
print("Element created!")
print("Number of points: " + str(len(elt.pointList)-1))
print("Bonus: " + str(elt.bonus))
print("Type: " + type)
        
element = elt
# ---------- end element ----------
element_2 = CreateElement(type=typechoice_3, points=[pt, pt_2, pt_5, pt_6])  # -> out, element; inputs points: list of Point3d; same code as element
element_3 = CreateElement(type=typechoice, points=[pt_6, pt_2, pt_4, pt_3])  # -> out, element; inputs points: list of Point3d; same code as element
panel = Panel(element.out)
panel_2 = Panel(element_2.out)
panel_3 = Panel(element_3.out)
floor = CreateFloor(elements=[element.element, element_2.element], numero=Slider(0, range=0..8))  # -> out, floor; inputs elements: list, numero: Int32
# ---------- floor: Python ----------
"""Provides a scripting component.
    Inputs:
        elements: The Elements in a same floor
        numero: the index of the floor; must be unique
    Output:
        Floor: The Floor as a floor"""

__author__ = "asjou"
__version__ = "2022.03.17"

import rhinoscriptsyntax as rs

from abitaPy2 import Point
from abitaPy2 import Element
from abitaPy2 import Floor


if numero == None:
    raise Exception("Please define a number for the floor.")
if len(elements) < 1:
    raise Exception("Please define at least 1 element.")

floor = Floor(no = numero)
for elt in elements:
    floor.addElement(elt)

print("Floor created!")
print("Number of elements: " + str(len(floor.elementList)))
print("Numero: " + str(floor.no))
# ---------- end floor ----------
floor_2 = CreateFloor(elements=element_3.element, numero=Slider(1, range=0..8))  # -> out, floor; inputs elements: list, numero: Int32; same code as floor
panel_4 = Panel(floor_2.out)
panel_5 = Panel(floor.out)
config = CreateAlgoConfig(floors=[floor.floor, floor_2.floor], nbSols=100, initIT=-1, endIT=-1, alpha=0)  # -> out, algo; inputs listTx: list, floors: list, nbSols: Int32, initIT: Int32, endIT: Int32
# ---------- config: Python ----------
"""Provides a scripting component.
    Inputs:
        listTx: The parameters for the Tx, can be left empty has it has a default parameter; be cautious that if you want to define it yourself you need to enter 5 elements in the rigth order
        floors: A list of Floors on which you want to search a solution
        nbSols: The number of solutions to compute; it has a default parameter already
        initIT: The first iteration number; it has a default parameter already
        endIT: The last iteration number; it has a default parameter already
        alpha: A coefficient for solving the problem; it has a default parameter already
    Output:
        algo: The unsolved problem as an instance of the class Algo"""

__author__ = "asjou"
__version__ = "2022.03.09"

import rhinoscriptsyntax as rs
import Rhino as rc
from abitaPy2 import Geom
from abitaPy2 import Population
from abitaPy2 import Algo
from abitaPy2 import Floor
from abitaPy2 import Element
from abitaPy2 import Point
from abitaPy2 import Tx


def searchInList(pt, list):
    for listPt in list:
        if pt.equals(listPt):
            return listPt
    return None

# init
geom = Geom()
popu = Population()
algo = Algo(geom, popu)

# use custom parameters
if nbSols: algo.nbSols = nbSols
if initIT: algo.initIT = initIT
if endIT: algo.endIT = endIT
if alpha: algo.alpha = alpha

# use Tx
if not listTx:
    listTx = [
        Tx(benefit=70.00,  areaMin=30.00, areaMax=45.00,  nbMin=0, nbMax=1000, no=1),
        Tx(benefit=80.00,  areaMin=45.00, areaMax=60.00,  nbMin=0, nbMax=1000, no=2),
        Tx(benefit=100.00, areaMin=60.00, areaMax=75.00,  nbMin=0, nbMax=1000, no=3),
        Tx(benefit=50.00,  areaMin=75.00, areaMax=85.00,  nbMin=0, nbMax=1000, no=4),
        Tx(benefit=40.00,  areaMin=85.00, areaMax=100.00, nbMin=0, nbMax=1000, no=5)
    ]
txListStr = ""
for tx in listTx:
    algo.addType(tx)
    txListStr += "T" + str(tx.no) + ", "

if not floors:
    raise Exception("Please define at least 1 floor.")

# create the geometry
floorId = -1
eltId = 0
pointId = 0
for floor in floors:
    geom.addFloor(floor)
    floorId += 1
    for elt in floor.elementList:
        elt.no = eltId
        eltId += 1
        elt.floorId = floorId
        newPointList = []
        for p in elt.pointList:
            p.floorId = floorId
            res = searchInList(p, geom.pointList)
            if not res:
                res = Point(p.x, p.y, floorId, pointId)
                geom.addPoint(res)
                pointId += 1
            newPointList.append(res)
        elt.pointList = newPointList
        geom.addElement(elt)

print("Problem configuration created!")
print("Number of floors: " + str(len(geom.floorList)))
print("Tx types: " + txListStr)
print("Number of solutions to generate: " + str(algo.nbSols))
# ---------- end config ----------
panel_6 = Panel("D:\Users\alexi\Downloads\Abita4Rhino\Examples\new_problem.abi")
panel_7 = Panel(config.out)
showproblem = ShowProblem(algo=config.algo)  # -> out, S_2, S, S_3, S_4
writeabi = WriteAbiFile(algo=config.algo, path=panel_6, run=Toggle(False))  # -> out; inputs run: Boolean
# ---------- writeabi: Python ----------
"""Provides a scripting component.
    Inputs:
        algo: The problem to write - can be solved or unsolved
        path: The path were the file will be written
        run: order for the algorithm to run"""

__author__ = "asjou"
__version__ = "2022.03.23"


from ply import lex
from abitaPy2 import utils

from abitaPy2 import Geom
from abitaPy2 import Population
from abitaPy2 import Algo
from abitaPy2 import AbiFile
import rhinoscriptsyntax as rs

if(path==""):
    print("Warning : no name nor path entered ! Default name writeAbi is set")
    fileNameIn="writeAbi"
else:
    fileNameIn=path
if(run):
    if len(fileNameIn) < 4 or fileNameIn[-4:] != ".abi":
        fileNameIn = fileNameIn + ".abi"
    file=AbiFile(fileNameIn)
    file.write(algo.geom,algo.popu,algo)
    print("The file is in location " + path + " and successfully written")
# ---------- end writeabi ----------
panel_8 = Panel(writeabi)
panel_9 = Panel(showproblem.out)
preview = CustomPreview(Geometry=showproblem.S_3, Material="red")
preview_2 = CustomPreview(Geometry=showproblem.S_2, Material="green")
preview_3 = CustomPreview(Geometry=showproblem.S_4, Material="purple")
preview_4 = CustomPreview(Geometry=showproblem.S, Material="yellow")

# ==== cluster ShowProblem
algo = ClusterInput()
showproblem = GhPythonScript(algo=algo)  # -> out, surfacesC, rangeC, surfacesL, rangeL, surfacesI, rangeI, surfacesX, rangeX
# ---------- showproblem: Python ----------
"""Provides a scripting component.
    Inputs:
        LElements: The elements from a floor
        IndiceSolution: The chosen solution
    Output:
        surfacesC: A data tree which has on each branch the 3d points corresponding to a surface of type C
        rangeC: The number of branches that has the surfacesC data tree
        surfacesL: A data tree which has on each branch the 3d points corresponding to a surface of type L
        rangeL: The number of branches that has the surfacesL data tree
        surfacesI: A data tree which has on each branch the 3d points corresponding to a surface of type I
        rangeI: The number of branches that has the surfacesI data tree
        surfacesX: A data tree which has on each branch the 3d points corresponding to a surface of type X
        rangeX: The number of branches that has the surfacesX data tree"""

__author__ = "asjou"
__version__ = "2022.03.09"

import rhinoscriptsyntax as rs
import Rhino as rc

# for accesssing GH classes
from Grasshopper.Kernel.Data import GH_Path
from Grasshopper import DataTree

from abitaPy2 import Algo
from abitaPy2 import Population
from abitaPy2 import Solution
from abitaPy2 import Lot

geom = algo.geom

def chooseType(elt):
    if(elt.common):
        if(elt.imposed):
            if(elt.exit):
                return(3)
            else:
                return(2)
        else:
            return(1)
    else:
        return(0)

#lsolutions=[[],[],[],[]]
#lsolutions=[surfacesL,surfacesC,surfacesI,surfacesX]


lsolutions=[DataTree[rc.Geometry.Point3d](),DataTree[rc.Geometry.Point3d](),DataTree[rc.Geometry.Point3d](),DataTree[rc.Geometry.Point3d]()]

i=[0,0,0,0]

for elt in geom.elementList:
    path = GH_Path(i[chooseType(elt)])
    pointList=[]
    for p in elt.pointList:
        floorNo = geom.floorList[p.floorId].no
        pointList.append(rc.Geometry.Point3d(p.x,p.y, floorNo * 2.5))
    lsolutions[chooseType(elt)].AddRange(pointList, path)
    i[chooseType(elt)]+=1


#Select solution:
surfacesL=lsolutions[0] #DataTree
rangeL=range(surfacesL.BranchCount)
surfacesC=lsolutions[1] #DataTree
rangeC=range(surfacesC.BranchCount)
surfacesI=lsolutions[2] #DataTree
rangeI=range(surfacesI.BranchCount)
surfacesX=lsolutions[3] #DataTree
rangeX=range(surfacesX.BranchCount)

print("The number of surfaces for each type are :")
print("L : " + str(surfacesL.BranchCount))
print("C : " + str(surfacesC.BranchCount))
print("I : " + str(surfacesI.BranchCount))
print("X : " + str(surfacesX.BranchCount))
# ---------- end showproblem ----------
out = ClusterOutput(showproblem.out)
surfaces = Surfaces(T=showproblem.surfacesL, P=showproblem.rangeL)
surfaces_2 = Surfaces(T=showproblem.surfacesC, P=showproblem.rangeC)
surfaces_3 = Surfaces(T=showproblem.surfacesI, P=showproblem.rangeI)
surfaces_4 = Surfaces(T=showproblem.surfacesX, P=showproblem.rangeX)
S = ClusterOutput(surfaces)
S_2 = ClusterOutput(surfaces_2)
S_3 = ClusterOutput(surfaces_3)
S_4 = ClusterOutput(surfaces_4)

# ==== cluster Surfaces
T = ClusterInput()
P = ClusterInput()
branch = TreeBranch(Tree=T, Path=P, MaintainPaths=True)
pline = PolyLine(Vertices=branch, Closed=Toggle(True))
boundary = BoundarySurfaces(Edges=pline)
S = ClusterOutput(boundary)
