# Grasshopper definition read_problem.gh (Grasshopper 1.0.7)

panel = Panel("D:\Users\alexi\Downloads\Abita4Rhino\Examples\G001_solved.abi")
readabi = ReadAbiFile(path=panel, run=Toggle(True))  # -> out, algo; inputs run: Boolean
# ---------- readabi: Python ----------
"""Provides a scripting component.
    Inputs:
        path: The complete path of the .abi file that we want to read
        run: A boolean which read the file when it is turned to true; default value is false
    Output:
        algo: The instance of the class Algo obtained when we read the file; the solution is not searched as we simply open the file here"""

__author__ = "asjou"
__version__ = "2022.03.23"

import rhinoscriptsyntax as rs

from ply import lex
from abitaPy2 import utils

from abitaPy2 import Geom
from abitaPy2 import Population
from abitaPy2 import Algo
from abitaPy2 import AbiFile



fileNameIn=path
if(run):
    if len(fileNameIn) < 4 or fileNameIn[-4:] != ".abi":
        fileNameIn = fileNameIn + ".abi"
    f=open(fileNameIn,"r")
    
    geom = Geom()
    popu = Population()
    alg = Algo(geom, popu)
    file = AbiFile(fileNameIn)
    file.read(geom, popu, alg)
    algo=alg
    print("File read successfully!")
# ---------- end readabi ----------
panel_2 = Panel(readabi.out)
showproblem = ShowProblem(algo=readabi.algo)  # -> out, S_2, S, S_3, S_4
panel_3 = Panel(showproblem.out)
preview = CustomPreview(Geometry=showproblem.S_3, Material="red")
preview_2 = CustomPreview(Geometry=showproblem.S_2, Material="green")
preview_3 = CustomPreview(Geometry=showproblem.S_4, Material="purple")
preview_4 = CustomPreview(Geometry=showproblem.S, Material="yellow")

# ==== cluster ShowProblem
algo = ClusterInput()
showproblem = GhPythonScript(algo=algo)  # -> out, surfacesC, rangeC, surfacesL, rangeL, surfacesI, rangeI, surfacesX, rangeX
# ---------- showproblem: Python ----------
"""Provides a scripting component.
    Inputs:
        LElements: The elements from a floor
        IndiceSolution: The chosen solution
    Output:
        surfacesC: A data tree which has on each branch the 3d points corresponding to a surface of type C
        rangeC: The number of branches that has the surfacesC data tree
        surfacesL: A data tree which has on each branch the 3d points corresponding to a surface of type L
        rangeL: The number of branches that has the surfacesL data tree
        surfacesI: A data tree which has on each branch the 3d points corresponding to a surface of type I
        rangeI: The number of branches that has the surfacesI data tree
        surfacesX: A data tree which has on each branch the 3d points corresponding to a surface of type X
        rangeX: The number of branches that has the surfacesX data tree"""

__author__ = "asjou"
__version__ = "2022.03.09"

import rhinoscriptsyntax as rs
import Rhino as rc

# for accesssing GH classes
from Grasshopper.Kernel.Data import GH_Path
from Grasshopper import DataTree

from abitaPy2 import Algo
from abitaPy2 import Population
from abitaPy2 import Solution
from abitaPy2 import Lot

geom = algo.geom

def chooseType(elt):
    if(elt.common):
        if(elt.imposed):
            if(elt.exit):
                return(3)
            else:
                return(2)
        else:
            return(1)
    else:
        return(0)

#lsolutions=[[],[],[],[]]
#lsolutions=[surfacesL,surfacesC,surfacesI,surfacesX]


lsolutions=[DataTree[rc.Geometry.Point3d](),DataTree[rc.Geometry.Point3d](),DataTree[rc.Geometry.Point3d](),DataTree[rc.Geometry.Point3d]()]

i=[0,0,0,0]

for elt in geom.elementList:
    path = GH_Path(i[chooseType(elt)])
    pointList=[]
    for p in elt.pointList:
        floorNo = geom.floorList[p.floorId].no
        pointList.append(rc.Geometry.Point3d(p.x,p.y, floorNo * 2.5))
    lsolutions[chooseType(elt)].AddRange(pointList, path)
    i[chooseType(elt)]+=1


#Select solution:
surfacesL=lsolutions[0] #DataTree
rangeL=range(surfacesL.BranchCount)
surfacesC=lsolutions[1] #DataTree
rangeC=range(surfacesC.BranchCount)
surfacesI=lsolutions[2] #DataTree
rangeI=range(surfacesI.BranchCount)
surfacesX=lsolutions[3] #DataTree
rangeX=range(surfacesX.BranchCount)

print("The number of surfaces for each type are :")
print("L : " + str(surfacesL.BranchCount))
print("C : " + str(surfacesC.BranchCount))
print("I : " + str(surfacesI.BranchCount))
print("X : " + str(surfacesX.BranchCount))
# ---------- end showproblem ----------
out = ClusterOutput(showproblem.out)
surfaces = Surfaces(T=showproblem.surfacesL, P=showproblem.rangeL)
surfaces_2 = Surfaces(T=showproblem.surfacesC, P=showproblem.rangeC)
surfaces_3 = Surfaces(T=showproblem.surfacesI, P=showproblem.rangeI)
surfaces_4 = Surfaces(T=showproblem.surfacesX, P=showproblem.rangeX)
S = ClusterOutput(surfaces)
S_2 = ClusterOutput(surfaces_2)
S_3 = ClusterOutput(surfaces_3)
S_4 = ClusterOutput(surfaces_4)

# ==== cluster Surfaces
T = ClusterInput()
P = ClusterInput()
branch = TreeBranch(Tree=T, Path=P, MaintainPaths=True)
pline = PolyLine(Vertices=branch, Closed=Toggle(True))
boundary = BoundarySurfaces(Edges=pline)
S = ClusterOutput(boundary)
