# Grasshopper definition solve_problem.gh (Grasshopper 1.0.7)

readabi = ReadAbiFile(path="D:\Users\alexi\Downloads\Abita4Rhino\Examples\G001.abi", run=Toggle(True))  # -> out, algo; inputs run: Boolean
# ---------- readabi: Python ----------
"""Provides a scripting component.
    Inputs:
        path: The complete path of the .abi file that we want to read
        run: A boolean which read the file when it is turned to true; default value is false
    Output:
        algo: The instance of the class Algo obtained when we read the file; the solution is not searched as we simply open the file here"""

__author__ = "asjou"
__version__ = "2022.03.23"

import rhinoscriptsyntax as rs

from ply import lex
from abitaPy2 import utils

from abitaPy2 import Geom
from abitaPy2 import Population
from abitaPy2 import Algo
from abitaPy2 import AbiFile



fileNameIn=path
if(run):
    if len(fileNameIn) < 4 or fileNameIn[-4:] != ".abi":
        fileNameIn = fileNameIn + ".abi"
    f=open(fileNameIn,"r")
    
    geom = Geom()
    popu = Population()
    algo = Algo(geom, popu)
    file = AbiFile(fileNameIn)
    file.read(geom, popu, algo)
    print("File read successfully!")
# ---------- end readabi ----------
panel = Panel(readabi.out)
computesolution = ComputeSolution(algo=readabi.algo, run=Toggle(False))  # -> out, algo_solved; inputs run: Boolean
# ---------- computesolution: Python ----------
"""Provides a scripting component.
    Inputs:
        algo: The instance of the class Algo on which we want to search for a solution
        run: boolean, set to true to run the programm
    Output:
        problemSolved: The Algo element after the computation of solutions"""

__author__ = "asjou"
__version__ = "2022.03.09"

import rhinoscriptsyntax as rs
import Rhino as rc


from abitaPy2 import Geom
from abitaPy2 import Population
from abitaPy2 import Algo
from abitaPy2 import Floor
from abitaPy2 import Element

if run:
    print("Running...")
    while algo.run():
        pass
    algo_solved = algo
    print("Run finished in " + str(algo.currentIteration()) + " iterations")
    print(str(algo.nbSols) + " solutions found.")
else:
    print("Please activate the run button")
# ---------- end computesolution ----------
panel_2 = Panel(computesolution.out)
showsolution = ShowSolution(algo=computesolution.algo_solved, numsolution=Slider(0, range=0..99))  # -> out, score, surfacescommon, surfacest1, surfacest2, surfacest3, surfacest4, surfacest5
panel_3 = Panel(showsolution.out)
panel_4 = Panel(showsolution.score)
preview = CustomPreview(Geometry=showsolution.surfacest2, Material="orange")
preview_2 = CustomPreview(Geometry=showsolution.surfacescommon, Material="green")
preview_3 = CustomPreview(Geometry=showsolution.surfacest3, Material="pink")
preview_4 = CustomPreview(Geometry=showsolution.surfacest1, Material="yellow")
preview_5 = CustomPreview(Geometry=showsolution.surfacest5, Material="purple")
preview_6 = CustomPreview(Geometry=showsolution.surfacest4, Material="red")

# ==== cluster ShowSolution
numsolution = ClusterInput()
algo = ClusterInput()
compute = GhPythonScript(algo=algo, numSolution=numsolution)  # -> out, score, surfacesCommon, rangeCommon, surfacesT1, rangeT1, surfacesT2, rangeT2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; inputs numSolution: Int32
# ---------- compute: Python ----------
"""Provides a scripting component.
    Inputs:
        algo: An instance of the algo class with a solution already computed
        numSolution: The chosen solution to show
    Output:
        surfacesCommon: A data tree which has on each branch the 3d points corresponding to a surface of type Common
        rangeCommon: The number of branches that has the surfacesCommon data tree
        surfacesT1: A data tree which has on each branch the 3d points corresponding to a surface of type T1
        rangeT1: The number of branches that has the surfacesT1 data tree
        surfacesT2: A data tree which has on each branch the 3d points corresponding to a surface of type T2
        rangeT2: The number of branches that has the surfacesT2 data tree
        surfacesT3: A data tree which has on each branch the 3d points corresponding to a surface of type T3
        rangeT3: The number of branches that has the surfacesT3 data tree
        surfacesT4: A data tree which has on each branch the 3d points corresponding to a surface of type T4
        rangeT4: The number of branches that has the surfacesT4 data tree
        surfacesT5: A data tree which has on each branch the 3d points corresponding to a surface of type T5
        rangeT5: The number of branches that has the surfacesT5 data tree"""

__author__ = "asjou"
__version__ = "2022.03.09"

import rhinoscriptsyntax as rs
import Rhino as rc

# for accesssing GH classes
from Grasshopper.Kernel.Data import GH_Path
from Grasshopper import DataTree

from abitaPy2 import Algo
from abitaPy2 import Population
from abitaPy2 import Solution
from abitaPy2 import Lot

sol=algo.popu.solutionList[numSolution]

#attributs utiles : lotList : List[Lot] ; elementList : List[Element] (The list of elements we use) ; distribution : List[int]

#lsolutions=[[],[],[],[],[],[]]
#lsolutions=[lsolutionsT1,lsolutionsT2,...,lsolutionsT5,lsolutionsC]
#surfC=DataTree[rc.Geometry.Point3d]()
#surfT1=DataTree[rc.Geometry.Point3d]()
#surfT2=DataTree[rc.Geometry.Point3d]()
#surfT3=DataTree[rc.Geometry.Point3d]()
#surfT4=DataTree[rc.Geometry.Point3d]()
#surfT5=DataTree[rc.Geometry.Point3d]()
#Chaque branche est un Lot distinct, afin de permettre le post traitement

lsolutions=[DataTree[rc.Geometry.Point3d](),DataTree[rc.Geometry.Point3d](),DataTree[rc.Geometry.Point3d](),DataTree[rc.Geometry.Point3d](),DataTree[rc.Geometry.Point3d](),DataTree[rc.Geometry.Point3d]()]

i=[0,0,0,0,0,0]

for lot in sol.lotList:
    type=5
    if(not lot.common):
        type=lot.typeNo
    path = GH_Path(i[type])
    i[type]+=1
    pointList=[]
    for p in lot.getPointList():
        if(rc.Geometry.Point3d(p.x,p.y,0) not in pointList):
            pointList.append(rc.Geometry.Point3d(p.x,p.y,0))
    lsolutions[type].AddRange(pointList, path)


#Select solution:
surfacesCommon=lsolutions[5] #DataTree
rangeCommon=range(surfacesCommon.BranchCount)

surfacesT1=lsolutions[0] #DataTree
rangeT1=range(surfacesT1.BranchCount)

surfacesT2=lsolutions[1] #DataTree
rangeT2=range(surfacesT2.BranchCount)

surfacesT3=lsolutions[2] #DataTree
rangeT3=range(surfacesT3.BranchCount)

surfacesT4=lsolutions[3] #DataTree
rangeT4=range(surfacesT4.BranchCount)

surfacesT5=lsolutions[4] #DataTree
rangeT5=range(surfacesT5.BranchCount)

print("The number of surfaces for each type are :")
print("Common : " + str(surfacesCommon.BranchCount))
print("T1 : " + str(surfacesT1.BranchCount))
print("T2 : " + str(surfacesT2.BranchCount))
print("T3 : " + str(surfacesT3.BranchCount))
print("T4 : " + str(surfacesT4.BranchCount))
print("T5 : " + str(surfacesT5.BranchCount))

score = sol.fitness
# ---------- end compute ----------
out = ClusterOutput(compute.out)
score = ClusterOutput(compute.score)
surfaces = Surfaces(T=compute.surfacesT1, P=compute.rangeT1)
surfaces_2 = Surfaces(T=compute.surfacesT2, P=compute.rangeT2)
surfaces_3 = Surfaces(T=compute.surfacesT3, P=compute.rangeT3)
surfaces_4 = Surfaces(T=compute.surfacesCommon, P=compute.rangeCommon)
surfaces_5 = Surfaces(T=compute.surfacesT4, P=compute.rangeT4)
surfaces_6 = Surfaces(T=compute.surfacesT5, P=compute.rangeT5)
surfacest1 = ClusterOutput(surfaces)  # The Surfaces of T1
surfacest2 = ClusterOutput(surfaces_2)  # The Surfaces of T2
surfacest3 = ClusterOutput(surfaces_3)  # The surfaces of T3
surfacescommon = ClusterOutput(surfaces_4)  # The Surfaces of commons
surfacest4 = ClusterOutput(surfaces_5)  # The surfaces of T4
surfacest5 = ClusterOutput(surfaces_6)  # The surfaces of T5

# ==== cluster Surfaces
T = ClusterInput()
P = ClusterInput()
branch = TreeBranch(Tree=T, Path=P, MaintainPaths=True)
pline = PolyLine(Vertices=branch, Closed=Toggle(True))
boundary = BoundarySurfaces(Edges=pline)
S = ClusterOutput(boundary)
